# Dynamo graph MeasureSynching.dyn (Dynamo 1.3.1.1736)

# group: INPUT
file_path = Filename("..\..\..\Desktop\journals\Journals_dhess\journal.0453.txt")

# group: Evaluate Journal
fromPath = FileObject(file_path)  # "File.FromPath"
readText = File.ReadText(fromPath)
byString = Custom[Journal.ByString](str=readText)

python_script = Python(IN[0]=byString)
# ---------- python_script.python (18 lines) ----------
import clr

OUT = []
if IN[0].__repr__() == 'Journal':
	allLines = IN[0].Lines
	allTimeStamps = IN[0].GetLinesByType('JournalTimeStamp')
	# Option 1: Sync with settings from ribbon
	allUIEvents = IN[0].GetLinesByType('JournalUIEvent')
	allPushButtonEvents = [x for x in allUIEvents if x.UIEventType == 'PushButton']
	allSyncs1StartCandidates = [x for x in allPushButtonEvents if x.Data[2] == 'Dialog_Revit_PartitionsSaveToMaster']
	allSyncs1Start = [x for x in allSyncs1StartCandidates if x.Data[4] == 'IDOK']
	allSyncs1StartTimeStampIndices = [allLines.index(x)+1 for x in allSyncs1Start]
	allSyncs1StartTimeStamps = [allLines[x].DateTime for x in allSyncs1StartTimeStampIndices]
	# Option 2: Quick sync from ribbon
	# Option 3: Sync with settings via keyboard shortcut
	# Option 4: Quick sync via keyboard shortcut
	# Option 5: Sync on exit
OUT = allSyncs1StartTimeStamps
# ----------------------------------------
