# Dynamo graph GenerateNodeDocumentationMarkdownFiles.dyn (Dynamo 2.16.1.2727)
# packages: Clockwork for Dynamo 2.x 2.4.0

# group: Generate Node Documentation Markdown Files
# note: This graph generates a markdown node documentation file for the doc folder.

# group: INPUTS
node_directory_path = Directory("C:\Users\adsk\Documents\andreas\repos\Journalysis\nodes\2.x")  # graph input
package_name = StringInput("Journalysis")
doc_directory_path = Directory("C:\Users\adsk\Documents\andreas\repos\Journalysis\doc")
text_template = StringInput("""## Sample file
- Download sample file: [All{0}Nodes.dyn](https://raw.githubusercontent.com/andydandy74/Journalysis/master/samples/2.x/All{0}Nodes.dyn)
- [More sample files](https://github.com/andydandy74/Journalysis/tree/master/samples/2.x)

## Useful links
- [Journalysis repository on GitHub](https://github.com/andydandy74/Journalysis)
- [Report an issue](https://github.com/andydandy74/Journalysis/issues)
- [Version history](https://github.com/andydandy74/Journalysis/wiki/Version-history)
- [Journalysis wiki](https://github.com/andydandy74/Journalysis/wiki)

![Journalysis logo](https://raw.githubusercontent.com/andydandy74/Journalysis/master/icons/raw/Journalysis.png)""")
placeholder = StringInput("{0}")

# group: Get node names from directory
fromPath = DirectoryObject(path=node_directory_path)  # "Directory.FromPath"
string = StringInput("*.dyf")  # graph input
getDirectoryContents = FileSystem.GetDirectoryContents(directory=fromPath, searchString=string)
boolean = BoolSelector(false)
fileName = FileSystem.FileName(path=getDirectoryContents.files, withExtension=boolean)

# group: Generate node docs
properties = Custom[CustomNode.Properties](path=getDirectoryContents.files)  # package Clockwork for Dynamo 2.x; Extracts information from a custom node.
code_block = CodeBlock(path=doc_directory_path, p1=properties.Category, p2=properties.Name)
# ---------- code_block.designscript (2 lines) ----------
// filename
path + "\\" + p1 + "." + p2 + ".md";
# ----------------------------------------
string_2 = StringInput(".")
split = String.Split(string=properties.Category, separator0=string_2)
firstItem = List.FirstItem(list=split@L2)
replace = String.Replace(string=text_template, searchFor=placeholder, replaceWith=firstItem)
writeText = FileSystem.WriteText(filePath=code_block, text=replace)
