# Dynamo custom node Journal.LoadedAssemblies.dyf (Dynamo 1.3.1.1736)
# category: Journalysis.Journal.Query

journal = Input()
python_script = Python(IN[0]=journal)
# ---------- python_script.python (12 lines) ----------
import clr

def process_input(func, input):
	if isinstance(input, list): return [func(x) for x in input]
	else: return func(input)

def journalLoadedAssemblies(journal):
	if journal.__repr__() == 'Journal':	
		return [x.MessageText.split(":")[-1].strip() for x in journal.GetLinesByType('JournalAPIMessage') if x.MessageText.startswith('Starting')]
	else: return []

OUT = process_input(journalLoadedAssemblies,IN[0])
# ----------------------------------------
loadedAssemblies = Output(python_script)
