# Dynamo graph AllNodes.dyn (Dynamo 1.3.1.1736)

# group: INPUT
# note: QUESTION:
# Does the graph execute okay? Do any nodes turn yellow?
journal_file_path = Filename("..\..\..\Desktop\journals\Journals_dhess\journal.0457_HardCrash.txt")
keyboardshortcuts_file_path = Filename("C:\Users\adieckmann\Desktop\KeyboardShortcuts.xml")

# group: Journal.Create
fromPath = FileObject(journal_file_path)  # "File.FromPath"
readText = File.ReadText(fromPath)
byString = Custom[Journal.ByString](str=readText)  # Creates a queriable object from the contents of a Revit journal file

# group: Journal.Query
user = Custom[Journal.User](journal=byString)  # Returns the Revit user name from a given journal
lineCount = Custom[Journal.LineCount](journal=byString)  # Returns the number of lines in a given journal
blockCount = Custom[Journal.BlockCount](journal=byString)  # Returns the number of blocks in a given journal
lines = Custom[Journal.Lines](journal=byString)  # Returns all lines of a given journal
path = Custom[Journal.Path](journal=byString)  # Returns the original path of a given journal
processingTime = Custom[Journal.ProcessingTime](journal=byString)  # Returns the time it took the Journal.ByString node to process a given journal
revitBuild = Custom[Journal.RevitBuild](journal=byString)  # Returns the Revit build from a given journal
revitBranch = Custom[Journal.RevitBranch](journal=byString)  # Returns the Revit branch from a given journal
revitVersion = Custom[Journal.RevitVersion](journal=byString)  # Returns the Revit version from a given journal
OSVersion = Custom[Journal.OSVersion](journal=byString)  # Returns the Windows version from a given journal
machine = Custom[Journal.Machine](journal=byString)  # Returns the computer name from a given journal
date = Custom[Journal.Date](journal=byString)  # Computes the date of a given journal

# group: Test Inputs
code_block = CodeBlock { {"JournalData","JournalDirective"}; "JournalTimeStamp"; "Description"; "idle0_doc"; 30..34; 30; }

# group: Journal.Actions
getLinesByType = Custom[Journal.GetLinesByType](journal=byString, journalLineType=code_block.out1)
getLinesByBlock = Custom[Journal.GetLinesByBlock](journal=byString, journalBlock=code_block.out4)
sessionTime = Custom[Journal.SessionTime](journal=byString)
startupTime = Custom[Journal.StartupTime](journal=byString)
loadedAssemblies = Custom[Journal.LoadedAssemblies](journal=byString)
sessionTerminatedProperly = Custom[Journal.SessionTerminatedProperly](journal=byString)
isInPlaybackMode = Custom[Journal.IsInPlaybackMode](journal=byString)
playbackInterrupted = Custom[Journal.PlaybackInterrupted](journal=byString)
containsAPIErrors = Custom[Journal.ContainsAPIErrors](journal=byString)
containsExceptions = Custom[Journal.ContainsExceptions](journal=byString)
maxRAMPeak = Custom[Journal.MaxRAMPeak](journal=byString)
maxVMPeak = Custom[Journal.MaxVMPeak](journal=byString)
minRAMAvailable = Custom[Journal.MinRAMAvailable](journal=byString)
minVMAvailable = Custom[Journal.MinVMAvailable](journal=byString)
getLinesByTypeAndProperty = Custom[Journal.GetLinesByTypeAndProperty](journal=byString, journalLineType=code_block.out1, property=code_block.out2, value=code_block.out3)
getDateTimeByBlock = Custom[Journal.GetDateTimeByBlock](journal=byString, journalBlock=code_block.out4)
stripComments = Custom[Journal.StripComments](journal=byString)  # Strips all comments from the original journal string and only returns all (re-formatted) lines that are potentially relevant for journal playback.
loadedModels = Custom[Journal.LoadedModels](journal=byString)
date_2 = Custom[Journal.Date](journal=byString)

# group: JournalLine.Query
number = Custom[JournalLine.Number](journalLine=lines)
type = Custom[JournalLine.Type](journalLine=lines)
block = Custom[JournalLine.Block](journalLine=lines)
rawText = Custom[JournalLine.RawText](journalLine=lines)

# group: Helpers
allJournalLineTypes = Custom[Helpers.AllJournalLineTypes]()  # Lists all JournalLine types
watch = Watch(allJournalLineTypes)
allJournalAPIMessageTypes = Custom[Helpers.AllJournalAPIMessageTypes]()
watch_2 = Watch(allJournalAPIMessageTypes)
allJournalCommandTypes = Custom[Helpers.AllJournalCommandTypes]()
watch_3 = Watch(allJournalCommandTypes)
allJournalMouseEventTypes = Custom[Helpers.AllJournalMouseEventTypes]()
watch_4 = Watch(allJournalMouseEventTypes)
allJournalTimeStampTypes = Custom[Helpers.AllJournalTimeStampTypes]()
watch_5 = Watch(allJournalTimeStampTypes)
allJournalUIEventTypes = Custom[Helpers.AllJournalUIEventTypes]()
watch_6 = Watch(allJournalUIEventTypes)
allLoadedModelEventTypes = Custom[Helpers.AllLoadedModelEventTypes]()  # Lists all LoadedModelEvent types
watch_7 = Watch(allLoadedModelEventTypes)

watch_8 = Watch(byString)

# group: JournalAPIMessage.Query
string = StringInput("JournalAPIMessage")
getLinesByType_2 = Custom[Journal.GetLinesByType](journal=watch_8, journalLineType=string)
text = Custom[JournalAPIMessage.Text](journalAPIMessage=getLinesByType_2)  # Returns the text from an APIMessage line
type_2 = Custom[JournalAPIMessage.Type](journalAPIMessage=getLinesByType_2)  # Returns the type of an APIMessage line

# group: JournalCommand.Query
string_2 = StringInput("JournalCommand")
getLinesByType_3 = Custom[Journal.GetLinesByType](journal=watch_8, journalLineType=string_2)
type_3 = Custom[JournalCommand.Type](journalCommand=getLinesByType_3)  # Returns the type of a JournalCommand line
description = Custom[JournalCommand.Description](journalCommand=getLinesByType_3)  # Returns the description of a JournalCommand line
ID = Custom[JournalCommand.ID](journalCommand=getLinesByType_3)  # Returns the command ID of a JournalCommand line

# group: JournalAddinEvent.Query
string_3 = StringInput("JournalAddinEvent")
getLinesByType_4 = Custom[Journal.GetLinesByType](journal=watch_8, journalLineType=string_3)
text_2 = Custom[JournalAddinEvent.Text](journalAddinEvent=getLinesByType_4)  # Returns the text from an AddinEvent line

# group: JournalData.Query
string_4 = StringInput("JournalData")
getLinesByType_5 = Custom[Journal.GetLinesByType](journal=watch_8, journalLineType=string_4)
key = Custom[JournalData.Key](journalData=getLinesByType_5)  # Returns the key of a JournalData line
values = Custom[JournalData.Values](journalData=getLinesByType_5)  # Returns the values from a JournalData line

# group: JournalDirective.Query
string_5 = StringInput("JournalDirective")
getLinesByType_6 = Custom[Journal.GetLinesByType](journal=watch_8, journalLineType=string_5)
key_2 = Custom[JournalDirective.Key](journalDirective=getLinesByType_6)  # Returns the key of a JournalDirective line
values_2 = Custom[JournalDirective.Values](journalDirective=getLinesByType_6)  # Returns the values from a JournalDirective line

# group: JournalGUIResourceUsage.Query
string_6 = StringInput("JournalGUIResourceUsage")
getLinesByType_7 = Custom[Journal.GetLinesByType](journal=watch_8, journalLineType=string_6)
available = Custom[JournalGUIResourceUsage.Available](journalGUIResourceUsage=getLinesByType_7)
used = Custom[JournalGUIResourceUsage.Used](journalGUIResourceUsage=getLinesByType_7)
user_2 = Custom[JournalGUIResourceUsage.User](journalGUIResourceUsage=getLinesByType_7)

# group: JournalKeyboardEvent.Query
string_7 = StringInput("JournalKeyboardEvent")
getLinesByType_8 = Custom[Journal.GetLinesByType](journal=watch_8, journalLineType=string_7)
key_3 = Custom[JournalKeyboardEvent.Key](journalKeyboardEvent=getLinesByType_8)  # Returns the pressed key of a KeyboardEvent line

# group: JournalMemoryMetrics.Query
string_8 = StringInput("JournalMemoryMetrics")
getLinesByType_9 = Custom[Journal.GetLinesByType](journal=watch_8, journalLineType=string_8)
VMAvailable = Custom[JournalMemoryMetrics.VMAvailable](journalMemoryMetrics=getLinesByType_9)  # Returns the available VM of a MemoryMetrics line
VMUsed = Custom[JournalMemoryMetrics.VMUsed](journalMemoryMetrics=getLinesByType_9)  # Returns the used VM of a MemoryMetrics line
VMPeak = Custom[JournalMemoryMetrics.VMPeak](journalMemoryMetrics=getLinesByType_9)  # Returns the peak VM of a MemoryMetrics line
RAMAvailable = Custom[JournalMemoryMetrics.RAMAvailable](journalMemoryMetrics=getLinesByType_9)  # Returns the available RAM of a MemoryMetrics line
RAMUsed = Custom[JournalMemoryMetrics.RAMUsed](journalMemoryMetrics=getLinesByType_9)  # Returns the used RAM of a MemoryMetrics line
RAMPeak = Custom[JournalMemoryMetrics.RAMPeak](journalMemoryMetrics=getLinesByType_9)  # Returns the peak RAM of a MemoryMetrics line

# group: JournalMouseEvent.Query
string_9 = StringInput("JournalMouseEvent")
getLinesByType_10 = Custom[Journal.GetLinesByType](journal=watch_8, journalLineType=string_9)
type_4 = Custom[JournalMouseEvent.Type](journalMouseEvent=getLinesByType_10)  # Returns the type of a MouseEvent line
data = Custom[JournalMouseEvent.Data](journalMouseEvent=getLinesByType_10)  # Returns the data from a MouseEvent line

# group: JournalTimeStamp.Query
string_10 = StringInput("JournalTimeStamp")
getLinesByType_11 = Custom[Journal.GetLinesByType](journal=watch_8, journalLineType=string_10)
type_5 = Custom[JournalTimeStamp.Type](journalTimeStamp=getLinesByType_11)  # Returns the type of a TimeStamp line
dateTime = Custom[JournalTimeStamp.DateTime](journalTimeStamp=getLinesByType_11)  # Returns the date and time of a TimeStamp line
description_2 = Custom[JournalTimeStamp.Description](journalTimeStamp=getLinesByType_11)  # Returns the description of a TimeStamp line

# group: JournalUIEvent.Query
string_11 = StringInput("JournalUIEvent")
getLinesByType_12 = Custom[Journal.GetLinesByType](journal=watch_8, journalLineType=string_11)
type_6 = Custom[JournalUIEvent.Type](journalUIEvent=getLinesByType_12)  # Returns the type of a UIEvent line
data_2 = Custom[JournalUIEvent.Data](journalUIEvent=getLinesByType_12)  # Returns the data from a UIEvent line

# group: Test Inputs
code_block_2 = CodeBlock { 4; }
getItemAtIndex = List.GetItemAtIndex(list=lines, index=code_block_2)
count = List.Count(lines)
code_block_3 = CodeBlock(n=count) { n-5; }
getItemAtIndex_2 = List.GetItemAtIndex(list=lines, index=code_block_3)
code_block_4 = CodeBlock { "JournalCommand"; "CommandID"; "ID_CANCEL_EDITOR"; }

# group: JournalLine.Actions
next = Custom[JournalLine.Next](journalLine=getItemAtIndex)
previous = Custom[JournalLine.Previous](journalLine=getItemAtIndex_2)
allNext = Custom[JournalLine.AllNext](journalLine=getItemAtIndex)
allPrevious = Custom[JournalLine.AllPrevious](journalLine=getItemAtIndex_2)
allNextOfType = Custom[JournalLine.AllNextOfType](journalLine=getItemAtIndex, journalLineType=code_block_4.out0)
allNextOfTypeAndProperty = Custom[JournalLine.AllNextOfTypeAndProperty](journalLine=getItemAtIndex, journalLineType=code_block_4.out0, property=code_block_4.out1, value=code_block_4.out2)
allPreviousOfType = Custom[JournalLine.AllPreviousOfType](journalLine=getItemAtIndex_2, journalLineType=code_block_4.out0)
allPreviousOfTypeAndProperty = Custom[JournalLine.AllPreviousOfTypeAndProperty](journalLine=getItemAtIndex_2, journalLineType=code_block_4.out0, property=code_block_4.out1, value=code_block_4.out2)
nextOfType = Custom[JournalLine.NextOfType](journalLine=getItemAtIndex, journalLineType=code_block_4.out0)
nextOfTypeAndProperty = Custom[JournalLine.NextOfTypeAndProperty](journalLine=getItemAtIndex, journalLineType=code_block_4.out0, property=code_block_4.out1, value=code_block_4.out2)
previousOfType = Custom[JournalLIne.PreviousOfType](journalLine=getItemAtIndex_2, journalLineType=code_block_4.out0)
previousOfTypeAndProperty = Custom[JournalLine.PreviousOfTypeAndProperty](journalLine=getItemAtIndex_2, journalLineType=code_block_4.out0, property=code_block_4.out1, value=code_block_4.out2)
getDateTimeOfBlock = Custom[JournalLIne.GetDateTimeOfBlock](journalLine=getItemAtIndex_2)

# group: Evaluate KeyboardShortcuts
fromPath_2 = FileObject(keyboardshortcuts_file_path)  # "File.FromPath"
readText_2 = File.ReadText(fromPath_2)
byString_2 = Custom[KeyboardShortcuts.ByString](str=readText_2)  # Creates a queriable object from the content of a Revit KeyboardShortcuts.xml file

# group: KeyboardShortcuts.Query
commands = Custom[KeyboardShortcuts.Commands](keyboardShortcuts=byString_2)  # Returns all commands from a given KeyboardShirtcuts object
commandCountWithShortcuts = Custom[KeyboardShortcuts.CommandCountWithShortcuts](keyboardShortcuts=byString_2)  # Returns the total number of commands that have a shortcut assigned in a given KeyboardShirtcuts object
commandCount = Custom[KeyboardShortcuts.CommandCount](keyboardShortcuts=byString_2)  # Returns the total number of commands in a given KeyboardShirtcuts object
commandsWithShortcuts = Custom[KeyboardShortcuts.CommandsWithShortcuts](keyboardShortcuts=byString_2)  # Returns all commands that have a shortcut assigned from a given KeyboardShirtcuts object

# group: KeyboardShortcutCommand.Query
hasPaths = Custom[KeyboardShortcutCommand.HasPaths](keyboardShortcutCommand=commands)  # Returns whether a given command has any paths assigned
hasShortcuts = Custom[KeyboardShortcutCommand.HasShortcuts](keyboardShortcutCommand=commands)  # Returns whether a given command has any shortcuts assigned
ID_2 = Custom[KeyboardShortcutCommand.ID](keyboardShortcutCommand=commands)  # Returns the ID of a given command
name = Custom[KeyboardShortcutCommand.Name](keyboardShortcutCommand=commands)  # Returns the name of a given command
paths = Custom[KeyboardShortcutCommand.Paths](keyboardShortcutCommand=commands)  # Returns all paths assigned to a given command
shortcuts = Custom[KeyboardShortcutCommand.Shortcuts](keyboardShortcutCommand=commands)  # Returns all shortcuts assigned to a given command

# group: LoadedModel.Query
path_2 = Custom[LoadedModel.Path](loadedModel=loadedModels)  # Returns the Rpath of a loaded model
events = Custom[LoadedModel.Events](loadedModel=loadedModels)  # Returns all events associated with a loaded model

# group: LoadedModelEvent.Query
type_7 = Custom[LoadedModelEvent.Type](loadedModelEvent=events@L2)  # Returns the type of a given LoadedModelEvent
dateTime_2 = Custom[LoadedModelEvent.DateTime](loadedModelEvent=events@L2)  # Returns the date and time of a given LoadedModelEvent

# group: LoadedModel.Actions
version = Custom[LoadedModel.Version](loadedModel=loadedModels)  # Retrieves the version of a loaded model
versionHistory = Custom[LoadedModel.VersionHistory](loadedModel=loadedModels)  # Retrieves the version history of a loaded model

# group: JournalBasicFileInfo.Query
string_12 = StringInput("JournalBasicFileInfo")
getLinesByType_13 = Custom[Journal.GetLinesByType](journal=watch_8, journalLineType=string_12)
centralModelPath = Custom[JournalBasicFileInfo.CentralModelPath](journalBasicFileInfo=getLinesByType_13)  # Returns the central model path from a BasicFileInfo line
lastSavePath = Custom[JournalBasicFileInfo.LastSavePath](journalBasicFileInfo=getLinesByType_13)  # Returns the last save path from a BasicFileInfo line
locale = Custom[JournalBasicFileInfo.Locale](journalBasicFileInfo=getLinesByType_13)  # Returns the locale a model was saved in from a BasicFileInfo line
worksharing = Custom[JournalBasicFileInfo.Worksharing](journalBasicFileInfo=getLinesByType_13)  # Returns the worksharing status from a BasicFileInfo line

fileName = Custom[JournalBasicFileInfo.FileName](journalBasicFileInfo=getLinesByType_13)  # Returns the file name from the last save path of a BasicFileInfo line
